# Grasshopper definition material-mapper.gh (Grasshopper 1.0.7)

number_slider = Slider(20, range=0..10000)
dx = Slider(0.1, range=0..1)
pipeline = GeometryPipeline(
    GroupByLayer=False,
    GroupByType=False,
    IncludeHidden=True,
    IncludeLocked=True,
    LayerFilter="Layer 01",
    NameFilter="*",
    SublayerFiltering=True,
    TypeFilter=1073741852)
pipeline_2 = GeometryPipeline(
    GroupByLayer=False,
    GroupByType=False,
    IncludeHidden=True,
    IncludeLocked=True,
    LayerFilter="Layer 02",
    NameFilter="*",
    SublayerFiltering=True,
    TypeFilter=1073741852)
pipeline_3 = GeometryPipeline(
    GroupByLayer=False,
    GroupByType=False,
    IncludeHidden=True,
    IncludeLocked=True,
    LayerFilter="Layer 03",
    NameFilter="*",
    SublayerFiltering=True,
    TypeFilter=1073741852)
pipeline_4 = GeometryPipeline(
    GroupByLayer=False,
    GroupByType=False,
    IncludeHidden=True,
    IncludeLocked=True,
    LayerFilter="Layer 04",
    NameFilter="*",
    SublayerFiltering=True,
    TypeFilter=1073741852)
pipeline_5 = GeometryPipeline(
    GroupByLayer=False,
    GroupByType=False,
    IncludeHidden=True,
    IncludeLocked=True,
    LayerFilter="Layer 05",
    NameFilter="*",
    SublayerFiltering=True,
    TypeFilter=1073741852)
geo = Geometry([pipeline, pipeline_2, pipeline_3, pipeline_4, pipeline_5])
cluster = Cluster(x_count_pts=number_slider, all_geometry=geo, y_count_pts=number_slider, dx=dx)  # disabled
test_tolerance = Slider(0.004, range=0..0.1)
cluster_2 = Cluster_4(k=Slider(3, range=0..10), rho=Slider(100, range=0..2000), c_p=Slider(100, range=0..2000), idx="0")
cluster_3 = Cluster_4(k=Slider(6, range=0..10), rho=Slider(100, range=0..2000), c_p=Slider(100, range=0..2000), idx="1")
cluster_4 = Cluster_2(discrete_points=cluster, geometry=pipeline, tolerance=test_tolerance, material_id="1")  # -> material_flag, srfs, crvs
cluster_5 = Cluster_2(discrete_points=cluster, geometry=pipeline_2, tolerance=test_tolerance, material_id="2")  # -> material_flag, srfs, crvs
cluster_6 = Cluster_2(discrete_points=cluster, geometry=pipeline_3, tolerance=test_tolerance, material_id="3")  # -> material_flag, srfs, crvs
cluster_7 = Cluster_2(discrete_points=cluster, geometry=pipeline_4, tolerance=test_tolerance, material_id="4")  # -> material_flag, srfs, crvs
cluster_8 = Cluster_2(discrete_points=cluster, geometry=pipeline_5, tolerance=test_tolerance, material_id="5")  # -> material_flag, srfs, crvs
cluster_9 = Cluster_4(k=Slider(2.3, range=0..10), rho=Slider(1000, range=0..2000), c_p=Slider(1000, range=0..2000), idx="2")
cluster_10 = Cluster_4(k=Slider(1, range=0..10), rho=Slider(200, range=0..2000), c_p=Slider(200, range=0..2000), idx="4")
cluster_11 = Cluster_4(k=Slider(0.039, range=0..10), rho=Slider(1450, range=0..2000), c_p=Slider(35, range=0..2000), idx="3")
material_flag = Number(cluster_5.material_flag)
material_flag_2 = Number(cluster_7.material_flag)
material_flag_3 = Number(cluster_8.material_flag)
material_flag_4 = Number(cluster_4.material_flag)
material_flag_5 = Number(cluster_6.material_flag)
merge = Merge(
    Data1=graft(material_flag_4),
    Data2=graft(material_flag),
    Data3=graft(material_flag_5),
    Data4=graft(material_flag_2),
    Data5=graft(material_flag_3))
python = GhPythonScript(defs=[cluster_2, cluster_3, cluster_9, cluster_11, cluster_10])  # -> out, definitions_table; inputs defs: list
# ---------- python: Python ----------
__author__ = "Sam Wolk"
__version__ = "2023.05.03"

import rhinoscriptsyntax as rs
import json

def_list = [json.loads(defn) for defn in defs]

def_list.sort(key=lambda defn: defn["idx"])

definitions_table = json.dumps(def_list)

print(definitions_table)
# ---------- end python ----------
cluster_12 = Cluster_3(merged_flags=merge)
tag = TextTag(Location=simplify(cluster), Text=cluster_12)  # disabled
python_2 = GhPythonScript(material_map=cluster_12, definitions_table=python.definitions_table, run=Button())  # -> out, a; inputs material_map: tree of Int32, run: Boolean
# ---------- python_2: Python ----------
__author__ = "Sam Wolk"
__version__ = "2023.05.03"

import rhinoscriptsyntax as rs
import urllib2
import json
import ghpythonlib.treehelpers as th


if run:
    map = []
    for i in range(material_map.BranchCount):
        row = [int(val) for val in material_map.Branch(i)]
        map.append(row)
    
    data = {
        "defs": json.loads(definitions_table),
        "map": map,
    }
    request = urllib2.Request("http://localhost:5000")
    request.add_data(json.dumps(data))
    request.add_header("Content-type", "application/json")
    request.add_header("Accept", "application/json")
    #
    res = urllib2.urlopen(request)
    res = json.load(res)
    print(res)
# ---------- end python_2 ----------
domain_y_m = Slider(2.555, range=0..10)  # disabled
conductor_width_m = Slider(0.096, range=0..1)  # disabled
domain_x_m = Slider(2.555, range=0..10)  # disabled
n_conductors = Slider(4, range=0..10)  # disabled
conductor_height_0_1 = Slider(1, range=0.5..3)  # disabled
bar_height_0_1 = Slider(0.145, range=0..1)  # disabled
cluster_13 = Cluster_5(
    domain_x_m=domain_x_m,
    domain_y_m=domain_y_m,
    bar_height_0_1=bar_height_0_1,
    n_conductors=n_conductors,
    conductor_height_0_1=conductor_height_0_1,
    conductor_width_m=conductor_width_m)  # -> base_solid, upper_bar, lower_bar, conductors; disabled
geo_2 = Geometry(cluster_13.conductors)  # disabled
geo_3 = Geometry(cluster_13.lower_bar)  # disabled
geo_4 = Geometry(cluster_13.base_solid)  # disabled
geo_5 = Geometry(cluster_13.upper_bar)  # disabled
dx_2 = Slider(0.01, range=0..1)  # disabled
number_slider_2 = Slider(20, range=0..10000)  # disabled
toggle = BooleanToggle(False)  # disabled
geo_6 = Geometry(flatten([geo_4, geo_5, geo_3, geo_2]))  # disabled
filter = StreamFilter(Gate=toggle, Stream1=geo_6)  # disabled
cluster_14 = Cluster(x_count_pts=number_slider_2, all_geometry=filter, y_count_pts=number_slider_2, dx=dx_2)  # disabled
test_tolerance_2 = Slider(0.004, range=0..0.1)  # disabled
number_slider_3 = Slider(100, range=0..2000)  # disabled
number_slider_4 = Slider(100, range=0..2000)  # disabled
number_slider_5 = Slider(6, range=0..10)  # disabled
number_slider_6 = Slider(100, range=0..2000)  # disabled
number_slider_7 = Slider(35, range=0..2000)  # disabled
number_slider_8 = Slider(100, range=0..2000)  # disabled
number_slider_9 = Slider(3, range=0..10)  # disabled
number_slider_10 = Slider(1450, range=0..2000)  # disabled
number_slider_11 = Slider(0.039, range=0..10)  # disabled
number_slider_12 = Slider(1000, range=0..2000)  # disabled
number_slider_13 = Slider(1000, range=0..2000)  # disabled
number_slider_14 = Slider(2.3, range=0..10)  # disabled
panel = Panel("1")  # disabled
panel_2 = Panel("2")  # disabled
panel_3 = Panel("4")  # disabled
panel_4 = Panel("3")  # disabled
panel_5 = Panel("0")  # disabled
cluster_15 = Cluster_2(discrete_points=cluster_14, geometry=geo_4, tolerance=test_tolerance_2, material_id=panel)  # -> material_flag, srfs, crvs; disabled
cluster_16 = Cluster_2(discrete_points=cluster_14, geometry=geo_5, tolerance=test_tolerance_2, material_id=panel_2)  # -> material_flag, srfs, crvs; disabled
cluster_17 = Cluster_2(discrete_points=cluster_14, geometry=geo_3, tolerance=test_tolerance_2, material_id=panel_4)  # -> material_flag, srfs, crvs; disabled
cluster_18 = Cluster_2(discrete_points=cluster_14, geometry=geo_2, tolerance=test_tolerance_2, material_id=panel_3)  # -> material_flag, srfs, crvs; disabled
panel_6 = Panel("3")  # disabled
panel_7 = Panel("1")  # disabled
panel_8 = Panel("2")  # disabled
cluster_19 = Cluster_4(k=number_slider_5, rho=number_slider_4, c_p=number_slider_3, idx=panel_6)  # disabled
cluster_20 = Cluster_4(k=number_slider_9, rho=number_slider_6, c_p=number_slider_8, idx=panel_5)  # disabled
cluster_21 = Cluster_4(k=number_slider_11, rho=number_slider_10, c_p=number_slider_7, idx=panel_7)  # disabled
cluster_22 = Cluster_4(k=number_slider_14, rho=number_slider_13, c_p=number_slider_12, idx=panel_8)  # disabled
material_flag_6 = Number(cluster_16.material_flag)  # disabled
material_flag_7 = Number(cluster_18.material_flag)  # disabled
material_flag_8 = Number(cluster_15.material_flag)  # disabled
material_flag_9 = Number(cluster_17.material_flag)  # disabled
merge_2 = Merge(Data1=graft(material_flag_8), Data2=graft(material_flag_6), Data3=graft(material_flag_9), Data4=graft(material_flag_7))  # disabled
python_3 = GhPythonScript(defs=[cluster_20, cluster_21, cluster_22, cluster_19])  # -> out, definitions_table; inputs defs: list; disabled; same code as python
cluster_23 = Cluster_3(merged_flags=merge_2)  # disabled
tag_2 = TextTag(Location=simplify(cluster_14), Text=cluster_23)  # disabled
button = Button()  # disabled
python_4 = GhPythonScript(material_map=cluster_23, definitions_table=python_3.definitions_table, run=button)  # -> out, a; inputs material_map: tree of Int32, run: Boolean; disabled; same code as python_2

# ==== cluster Cluster
all_geometry = ClusterInput()
bbox = BoundingBox(AllGeometry=all_geometry, Plane=PlaneXY(0, 0, 0), UnionBox=True)  # -> Box, Box_2
dx = ClusterInput()
debox = DeconstructBox(Box=bbox.Box)  # -> Plane, X, Y, Z
dedomain = DeconstructDomain(Domain=debox.X)  # -> Start, End
dedomain_2 = DeconstructDomain(Domain=debox.Y)  # -> Start, End
expression = Expression(start=dedomain.Start, end=dedomain.End, dx=dx, Expression="floor((end-start)/dx)")
x_count_pts = ClusterInput()  # disabled
expression_2 = Expression(start=dedomain_2.Start, end=dedomain_2.End, dx=dx, Expression="floor((end-start)/dx)")
y_count_pts = ClusterInput()  # disabled
subtraction = Subtraction(XCountPts=x_count_pts, B=1)  # disabled
subtraction_2 = Subtraction(YCountPts=y_count_pts, B=1)  # disabled
planesrf = PlaneSurface(Plane=debox.Plane, XSize=debox.X, YSize=debox.Y)  # disabled
series = Series(Start=0, Step=dx, Count=expr("x+1", expression_2))
series_2 = Series(Start=0, Step=dx, Count=expr("x+1", expression))
sdivide = DivideSurface(Surface=planesrf, UCount=expression, VCount=expression_2)  # -> DiscretePoints, Normals, Parameters; disabled
addition = Addition(A=dedomain.Start, B=series_2)
addition_2 = Addition(A=dedomain_2.Start, B=series)
number_slider = Slider(10, range=0..10)  # disabled
crossref = CrossReference(ListA=addition_2, ListB=addition, CrossMode=1)  # -> ListA, ListB
pt = ConstructPoint(XCoordinate=crossref.ListB, YCoordinate=crossref.ListA, ZCoordinate=0)
item = ListItem(List=sdivide.DiscretePoints, Index=number_slider, Wrap=True)  # disabled
partition = PartitionList(List=pt, Size=expr("x+1", expression))
item_2 = ListItem(List=sdivide.DiscretePoints, Index=number_slider, Wrap=True)  # disabled
C = ClusterOutput(partition)

# ==== cluster Cluster_2
geometry = ClusterInput()
tolerance = ClusterInput()
discrete_points = ClusterInput()
material_id = ClusterInput()
geometry_2 = Surface(geometry)
srf_cp = SurfaceClosestPoint(DiscretePoints=graft(discrete_points), Surface=geometry_2)  # -> Point, UVPoint, Distance
smaller = SmallerThan(FirstNumber=srf_cp.Distance, SecondNumber=tolerance)  # -> SmallerThan, OrEqualTo
ma = MassAddition(Input=smaller.OrEqualTo)  # -> simplify(Result), PartialResults
trim = TrimTree(Tree=ma.Result, Depth=1)
min = Minimum(A=trim, B="1")
multiplication = Multiplication(A=min, MaterialID=material_id)
material_flag = ClusterOutput(multiplication)
srfs = ClusterOutput(geometry_2)
crvs = ClusterOutput(geometry)

# ==== cluster Cluster_3
merged_flags = ClusterInput()
sort = SortList(MergedFlags=merged_flags)  # -> Keys, ValuesA
rev = ReverseList(List=sort.Keys)
item = ListItem(List=rev, Index=0, Wrap=True)
trim = TrimTree(Tree=item, Depth=1)
subtraction = Subtraction(A=trim, B=1)
R = ClusterOutput(subtraction)

# ==== cluster Cluster_4
idx = ClusterInput()
k = ClusterInput()
rho = ClusterInput()
c_p = ClusterInput()
python = GhPythonScript(k=k, rho=rho, c_p=c_p, idx=idx)  # -> out, Material_Definition; inputs idx: Int32
# ---------- python: Python ----------
__author__ = "Sam Wolk"
__version__ = "2023.05.03"

import rhinoscriptsyntax as rs
import json
Material_Definition =  json.dumps({
    "k": k,
    "rho": rho,
    "c_p": c_p,
    "idx": idx
})
# ---------- end python ----------
material_definition = ClusterOutput(python.Material_Definition)

# ==== cluster Cluster_5
bar_height_0_1 = ClusterInput()
domain_y_m = ClusterInput()
domain_x_m = ClusterInput()
conductor_height_0_1 = ClusterInput()
n_conductors = ClusterInput()
conductor_width_m = ClusterInput()
domain_y_m_2 = Number(domain_y_m)
multiplication = Multiplication(DomainY_m=domain_y_m_2, BarHeight_0_1=bar_height_0_1)
domain_x_m_2 = Number(domain_x_m)
division = Division(A=domain_y_m_2, B=2)
planesrf = PlaneSurface(Plane=PlaneXY(0, 0, 0), XSize=domain_x_m_2, YSize=domain_y_m_2)
base_solid = ClusterOutput(planesrf)
planesrf_2 = PlaneSurface(Plane=PlaneXY(0, 0, 0), XSize=domain_x_m_2, YSize=multiplication)
neg = Negative(Value=multiplication)
Y = UnitY(Factor=division)
move = Move(Geometry=planesrf_2, Motion=Y)  # -> UpperBar, Transform
upper_bar = ClusterOutput(move.UpperBar)
Y_2 = UnitY(Factor=neg)
move_2 = Move(Geometry=move.UpperBar, Motion=Y_2)  # -> LowerBar, Transform
lower_bar = ClusterOutput(move_2.LowerBar)
debrep = DeconstructBrep(Brep=move.UpperBar)  # -> Faces, Edges, Vertices
addition = Addition(NConductors=n_conductors, B=" 1")
item = ListItem(List=debrep.Vertices, Index=0, Wrap=True)  # -> Item, Item1
ln = Line(StartPoint=item.Item, EndPoint=item.Item1)
subtraction = Subtraction(A=addition, B="1")
dom = ConstructDomain(DomainStart="1", DomainEnd=subtraction)
divide = DivideCurve(Curve=ln, Count=addition, Kinks=False)  # -> Points, Tangents, Parameters
subset = SubList(List=divide.Points, Domain=dom, Wrap=True)  # -> List, Index
num = Number(multiplication)
neg_2 = Negative(Value=num)
conductor_width_m_2 = Number(conductor_width_m)
neg_3 = Negative(Value=conductor_width_m_2)
dom_2 = ConstructDomain(DomainStart=neg_2, DomainEnd=num)
dom_3 = ConstructDomain(DomainStart=neg_3, DomainEnd=conductor_width_m_2)
planesrf_3 = PlaneSurface(Plane=subset.List, XSize=dom_3, YSize=dom_2)
scale_nu = ScaleNU(Geometry=planesrf_3, Plane=subset.List, ScaleX=1, ConductorHeight_0_1=conductor_height_0_1, ScaleZ=1)  # -> Conductors, Transform
conductors = ClusterOutput(scale_nu.Conductors)
