# Grasshopper definition t-beam-generator.gh (Grasshopper 1.0.7)

number_slider = Slider(0.97, range=0.1..2)  # disabled
number_slider_2 = Slider(0.52, range=0.1..2)  # disabled
b1 = Slider(3.361, range=1..4)  # disabled
h1 = Slider(0.959, range=0.1..4)  # disabled

number_slider_3 = Slider(100, range=0..100)  # disabled
panel = Panel("-1 to 1")  # disabled
range = Range(Domain=panel, Steps=number_slider_3)  # -> graft(Range); disabled
number_slider_4 = Slider(-0.36, range=-3..0)  # disabled
number_slider_5 = Slider(10, range=0..10)  # disabled
number_slider_6 = Slider(-0.47, range=-3..0)  # disabled
multiplication = Multiplication(A=range, B=range)  # disabled
range_2 = Range(Domain=number_slider_5, Steps=number_slider_3)  # -> graft(Range); disabled
multiplication_2 = Multiplication(A=multiplication, B=number_slider_4)  # disabled
addition = Addition(A=multiplication_2, B=number_slider_6)  # disabled
pt = ConstructPoint(XCoordinate=range_2, YCoordinate=0, ZCoordinate=addition)  # disabled

number_slider_7 = Slider(4, range=0..10)  # disabled
b2 = Slider(0.581, range=0.1..4)  # disabled
h2 = Slider(4, range=1..4)  # disabled

# ---- group: Base Point (Top Corner)
pt_2 = ConstructPoint(XCoordinate=0, YCoordinate=0, ZCoordinate=0)  # disabled
yz = YZPlane(Origin=pt_2)  # disabled

# ----
addition_2 = Addition(A=number_slider_2, B=number_slider)  # disabled
panel_2 = Panel("1")  # disabled
dom = ConstructDomain(DomainStart=number_slider_2, DomainEnd=addition_2)  # disabled
number_slider_8 = Slider(1, range=0..1)  # disabled
dom_2 = ConstructDomain(DomainStart=number_slider_2, DomainEnd=addition_2)  # disabled
subtraction = Subtraction(A=number_slider_7, B=panel_2)  # disabled
b1_2 = Slider(1.439, range=0.1..4)
length = Slider(22.58, range=0..100)
b2_2 = Slider(0.313, range=0.1..4)
h1_kinda = Slider(0.65, range=0..3)

# ---- group: Top Rectangle
panel_3 = Panel("2")  # disabled
division = Division(A=b1, B=panel_3)  # disabled
neg = Negative(Value=h1)  # disabled
rectangle = Rectangle(Plane=yz, XSize=b1, YSize=neg, Radius=0)  # -> Rectangle, Length; disabled
geo = Geometry(rectangle.Rectangle)  # disabled

# ----
number_slider_9 = Slider(0.91, range=0..3)

vert = Expression(h_1=h1, h_2=h2, Expression="h_1 + h_2/2")  # disabled
expression = Expression(b=[b1, b2], h=[h1, h2], Expression="b*h*h*h/12")  # disabled
expression_2 = Expression(b=[b1, b2], h=[h1, h2], Expression="b*h*h*h/12")  # disabled
expression_3 = Expression(h_1=h1, Expression="h_1/2")  # disabled
expression_4 = Expression(b=[b1, b2], h=[h1, h2], Expression="b*h")  # disabled
b_1_2 = Expression(b_1=b1, Expression="b_1/2")  # disabled
merge = Merge(Data1=expression_3, Data2=vert)  # disabled
expression_5 = Expression(areas=expression_4, vert_coms=merge, Expression="areas*vert_coms")  # disabled
ma = MassAddition(Weighted_areas=expression_5)  # -> Com_numerator, PartialResults; disabled
ma_2 = MassAddition(Input=expression_4)  # -> Total_area, PartialResults; disabled
expression_6 = Expression(total_area=ma_2.Total_area, com_num=ma.Com_numerator, Expression="com_num / total_area")  # disabled
expression_7 = Expression(vert_com=expression_6, vert_coms=merge, Expression="vert_coms - vert_com")  # disabled
I = Expression(I=expression, a=expression_4, d=expression_7, Expression="I+a*d*d")  # disabled
ma_3 = MassAddition(Input=I)  # -> Result, PartialResults; disabled
panel_4 = Panel(ma_3.Result)  # disabled

range_3 = Range(Domain=dom, Steps=subtraction)  # -> graft(Range); disabled
series = Series(Start=number_slider_8, Step=1, Count=number_slider_7)  # -> graft(Series); disabled
b1_3 = Slider(3.361, range=1..4)  # disabled

# ---- group: Bottom Rectangle
panel_5 = Panel("2")  # disabled
division_2 = Division(A=b2, B=panel_5)  # disabled
neg_2 = Negative(Value=division_2)  # disabled
dom_3 = ConstructDomain(DomainStart=neg_2, DomainEnd=division_2)  # disabled
neg_3 = Negative(Value=h2)  # disabled
pt_3 = ConstructPoint(XCoordinate=0, YCoordinate=division, ZCoordinate=neg)  # disabled
yz_2 = YZPlane(Origin=pt_3)  # disabled
rectangle_2 = Rectangle(Plane=yz_2, XSize=dom_3, YSize=neg_3, Radius=0)  # -> Rectangle, Length; disabled

# ----
b2_3 = Slider(0.581, range=0.1..4)  # disabled
rev = ReverseList(List=series)  # disabled
h2_2 = Slider(4, range=1..4)  # disabled

# ---- group: Base Point (Top Corner)
pt_4 = ConstructPoint(XCoordinate=0, YCoordinate=0, ZCoordinate=0)
yz_3 = YZPlane(Origin=pt_4)

# ----
neg_4 = Negative(Value=Slider(0.43, range=0..3))
range_4 = Range(Domain=length, Steps="2")
addition_3 = Addition(A=h1_kinda, B=neg_4)
merge_2 = Merge(Data1=addition_3, Data2=h1_kinda, Data3=addition_3)
merge_3 = Merge(Data1=number_slider_9, Data2=Slider(0.93, range=0..3), Data3=number_slider_9)
neg_5 = Negative(Value=merge_2)
neg_6 = Negative(Value=merge_3)
pt_5 = ConstructPoint(XCoordinate=range_4, YCoordinate=0, ZCoordinate=neg_5)
addition_4 = Addition(A=neg_5, B=neg_6)
pt_6 = ConstructPoint(XCoordinate=range_4, YCoordinate=0, ZCoordinate=addition_4)
nurbs = NurbsCurve(Vertices=pt_5, Degree=2, Periodic=False)  # -> Curve, Length, Domain
nurbs_2 = NurbsCurve(Vertices=pt_6, Degree=2, Periodic=False)  # -> Curve, Length, Domain
Y = UnitY(Factor=b2_2)
move = Move(Geometry=nurbs_2.Curve, Motion=Y)  # -> Geometry, Transform
Y_2 = UnitY(Factor=b1_2)
move_2 = Move(Geometry=nurbs.Curve, Motion=Y)  # -> Geometry, Transform
neg_7 = Negative(Value=Y_2)
merge_4 = Merge(Data1=nurbs_2.Curve, Data2=move.Geometry)
move_3 = Move(Geometry=move_2.Geometry, Motion=Y_2)  # -> Geometry, Transform
loft = Loft(Curves=merge_4, Options={Adjust=False, Closed=False, LoftEnds=0, LoftSimp=0, LoftType=0, Rebuild=10, Refit=0.01})
move_4 = Move(Geometry=nurbs.Curve, Motion=neg_7)  # -> Geometry, Transform
merge_5 = Merge(Data1=move_2.Geometry, Data2=move_3.Geometry)
merge_6 = Merge(Data1=nurbs.Curve, Data2=move_4.Geometry)
merge_7 = Merge(Data1=nurbs.Curve, Data2=nurbs_2.Curve)
project = Project(Geometry=move_3.Geometry, Plane=PlaneXY(0, 0, 0))  # -> Geometry, Transform
loft_2 = Loft(Curves=merge_5, Options={Adjust=False, Closed=False, LoftEnds=0, LoftSimp=0, LoftType=0, Rebuild=10, Refit=0.01})
project_2 = Project(Geometry=move_4.Geometry, Plane=PlaneXY(0, 0, 0))  # -> Geometry, Transform
loft_3 = Loft(Curves=merge_6, Options={Adjust=False, Closed=False, LoftEnds=0, LoftSimp=0, LoftType=0, Rebuild=10, Refit=0.01})
loft_4 = Loft(Curves=merge_7, Options={Adjust=False, Closed=False, LoftEnds=0, LoftSimp=0, LoftType=0, Rebuild=10, Refit=0.01})
merge_8 = Merge(Data1=move_4.Geometry, Data2=project_2.Geometry)
merge_9 = Merge(Data1=move_3.Geometry, Data2=project.Geometry)
move_5 = Move(Geometry=loft_4, Motion=Y)  # -> Geometry, Transform
loft_5 = Loft(Curves=merge_8, Options={Adjust=False, Closed=False, LoftEnds=0, LoftSimp=0, LoftType=0, Rebuild=10, Refit=0.01})
loft_6 = Loft(Curves=merge_9, Options={Adjust=False, Closed=False, LoftEnds=0, LoftSimp=0, LoftType=0, Rebuild=10, Refit=0.01})
merge_10 = Merge(Data1=project_2.Geometry, Data2=project.Geometry)
loft_7 = Loft(Curves=merge_10, Options={Adjust=False, Closed=False, LoftEnds=0, LoftSimp=0, LoftType=0, Rebuild=10, Refit=0.01})
merge_11 = Merge(Data1=loft_4, Data2=loft, Data3=move_5.Geometry, Data4=loft_2, Data5=loft_6, Data6=loft_7, Data7=loft_5, Data8=loft_3)
join = BrepJoin(Breps=merge_11)  # -> Breps, Closed
cap = CapHoles(Brep=join.Breps)

panel_6 = Panel("0")

# ---- group: Top Rectangle
panel_7 = Panel("2")  # disabled
division_3 = Division(A=b1_3, B=panel_7)  # disabled
neg_8 = Negative(Value=range_3)  # disabled
rectangle_3 = Rectangle(Plane=yz_3, XSize=b1_3, YSize=neg_8, Radius=0)  # -> Rectangle, Length; disabled
geo_2 = Geometry(rectangle_3.Rectangle)  # disabled

# ---- group: Bottom Rectangle
panel_8 = Panel("2")  # disabled
division_4 = Division(A=b2_3, B=panel_8)  # disabled
neg_9 = Negative(Value=division_4)  # disabled
dom_4 = ConstructDomain(DomainStart=neg_9, DomainEnd=division_4)  # disabled
neg_10 = Negative(Value=rev)  # disabled
pt_7 = ConstructPoint(XCoordinate=0, YCoordinate=division_3, ZCoordinate=neg_8)  # disabled
yz_4 = YZPlane(Origin=pt_7)  # disabled
rectangle_4 = Rectangle(Plane=yz_4, XSize=dom_4, YSize=neg_10, Radius=0)  # -> Rectangle, Length; disabled
geo_3 = Geometry(rectangle_4.Rectangle)  # disabled

# ---- group: COM: Geo Derived
area = Area(Geometry=[rectangle.Rectangle, rectangle_2.Rectangle])  # -> Area, Centroid; disabled
pdecon = Deconstruct(Point=area.Centroid)  # -> XComponent, YComponent, ZComponent; disabled
multiplication_3 = Multiplication(A=area.Area, B=pdecon.ZComponent)  # disabled
ma_4 = MassAddition(Input=area.Area)  # -> Result, PartialResults; disabled
ma_5 = MassAddition(Input=multiplication_3)  # -> Result, PartialResults; disabled
division_5 = Division(A=ma_5.Result, B=ma_4.Result)  # disabled
pt_8 = ConstructPoint(XCoordinate=0, YCoordinate=division, ZCoordinate=division_5)  # disabled
panel_9 = Panel(pt_8)  # disabled

# ---- group: COM: Explicit
geo_4 = Geometry(rectangle_2.Rectangle)  # disabled
join_2 = BrepJoin(Breps=[geo_4, geo])  # -> Breps, Closed; disabled
fmerge = MergeFaces(Brep=join_2.Breps)  # -> Breps, Before, After; disabled
area_2 = Area(Geometry=fmerge.Breps)  # -> Area, Centroid; disabled
panel_10 = Panel(area_2.Centroid)  # disabled

# ---- group: I: Parallel Axis
amoments = AreaMoments(Geometry=[rectangle.Rectangle, rectangle_2.Rectangle])  # -> Area, Centroid, Inertia, InertiaError, Secondary, SecondaryError, Gyration; disabled
pdecon_2 = Deconstruct(Point=amoments.Centroid)  # -> XComponent, YComponent, ZComponent; disabled
pdecon_3 = Deconstruct(Point=amoments.Inertia)  # -> XComponent, YComponent, ZComponent; disabled
subtraction_2 = Subtraction(A=division_5, B=pdecon_2.ZComponent)  # disabled
multiplication_4 = Multiplication(A=subtraction_2, B=subtraction_2)  # disabled
multiplication_5 = Multiplication(A=multiplication_4, B=amoments.Area)  # disabled
addition_5 = Addition(A=multiplication_5, B=pdecon_3.YComponent)  # disabled
ma_6 = MassAddition(Input=addition_5)  # -> Result, PartialResults; disabled
panel_11 = Panel(ma_6.Result)  # disabled

# ----
merge_12 = Merge(Data1=geo_2, Data2=geo_3)  # disabled
join_3 = BrepJoin(Breps=merge_12)  # -> Breps, Closed; disabled
fmerge_2 = MergeFaces(Brep=join_3.Breps)  # -> Breps, Before, After; disabled

# ---- group: I: Explicit
amoments_2 = AreaMoments(Geometry=fmerge.Breps)  # -> Area, Centroid, Inertia, InertiaError, Secondary, SecondaryError, Gyration; disabled
pdecon_4 = Deconstruct(Point=amoments_2.Inertia)  # -> XComponent, YComponent, ZComponent; disabled
panel_12 = Panel(pdecon_4.YComponent)  # disabled

# ----
deplane = DeconstructPlane(Plane=yz_3)  # -> Origin, XAxis, YAxis, ZAxis; disabled
series_2 = Series(Start=0, Step=1, Count=number_slider_7)  # disabled
multiplication_6 = Multiplication(A=deplane.ZAxis, B=series_2)  # disabled
move_6 = Move(Geometry=fmerge_2.Breps, Motion=graft(multiplication_6))  # -> Geometry, Transform; disabled

preview = CustomPreview(
    Geometry=cap,
    Material={diffuse=RGB(221, 160, 221), emission=RGB(66, 48, 66), shine=0.5, specular=RGB(255, 255, 255), transparency=0})
